# Grasshopper definition HydroFlow.gh (Grasshopper 0.9.70)

# ----
# Set the NURBS surface
# or rebuild it from points.
pt = Point([<point referenced from the Rhino model> x5000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])
# TITLE:Subtitle
# Description:
# Traces simulated flow paths for surface water.
# 
# Author(s): Luke Booth
# GH Version: ?
# Last Modified by: Luke Booth
# Last Modified Date: 2016-12-14
# Required Plugins: None
# Additional Assets Required: None
# 
# Notes/Issues:
srf = Surface()
patch = Patch(Points=pt, Spans=20, Flexibility=1, Trim=True)

# ----
# grid of points that
# simulation originates from
# (start with a low number)
slider = Slider(10, range=0..200)  # disabled
srf_2 = Surface(patch)  # disabled
sdivide = DivideSurface(Surface=srf_2, UCount=slider, VCount=slider)  # -> Points, Normals, Parameters; disabled

# ----
# generates lines of flow
# for a specified distance
distance_factor = Slider(20, range=0.1..200)  # disabled
vb = VBScript(base_srf=srf_2, input_pt=sdivide.Points, distance_factor=distance_factor)  # -> out, A; inputs base_srf: Surface, input_pt: list of Point3d; disabled
# ---------- vb: VB ----------
    Dim output_crvs As New List(Of PolylineCurve)

    For Each pt As point3d In input_pt

      Dim output_pts As New List(Of Point3d)

      output_pts.Add(pt)

      Dim output_pt As point3d

      Do

        outputpoint(base_srf, pt, distance_factor, output_pt)

        output_pts.add(output_pt)

        pt = output_pt

        If output_pts.Count > 100 Then

          Exit Do

        End If

      Loop While outputpoint(base_srf, pt, distance_factor, output_pt) = True

      Dim output_crv As New PolylineCurve(output_pts)

      output_crvs.Add(output_crv)

    Next

    A = output_crvs
# ---------- vb: VB additional code ----------
  Private Function outputpoint(ByVal base_srf As Surface, ByVal input_pt As Point3d, ByVal distance_factor As Double, ByRef A As Object) As Boolean

    Dim u, v As Double

    base_srf.ClosestPoint(input_pt, u, v)

    Dim normal_vector As New Vector3d(base_srf.NormalAt(u, v))

    Dim translation_vector As vector3d = vector3d.CrossProduct(normal_vector, vector3d.ZAxis)

    translation_vector.Unitize

    translation_vector.Transform(Transform.Rotation(Math.PI * 0.5, normal_vector, input_pt))

    Dim moved_pt As point3d = input_pt + distance_factor * translation_vector

    base_srf.ClosestPoint(moved_pt, u, v)

    Dim output_pt As Point3d = base_srf.PointAt(u, v)

    If output_pt.Z >= input_pt.Z Then

      outputpoint = False

    Else

      outputpoint = True

    End If

    A = output_pt

  End Function
# ---------- end vb ----------

crv = Curve(vb.A)  # disabled
