# Grasshopper definition TopoAnalysis.gh (Grasshopper 0.9.70)

# ----
# Set your mesh, or
# rebuild it from points.
pt = Point([<point referenced from the Rhino model> x4760])
# TITLE:Subtitle
# Description:
# graphic analysis of surface slope and elevation
# 
# Author(s): Luke Booth
# GH Version: ?
# Last Modified by: Luke Booth
# Last Modified Date: 2016-12-14
# Required Plugins: None
# Additional Assets Required: None
# 
# Notes/Issues:
mesh = Mesh()
del = DelaunayMesh(Points=pt, Plane=PlaneXY(0, 0, 0))

number_slider = Slider(10, range=0..10)  # disabled
srf = Surface(<surface referenced from the Rhino model>)  # disabled
sdivide = DivideSurface(Surface=srf, UCount=number_slider, VCount=number_slider)  # -> Points, Normals, Parameters; disabled

# ----
# Slope Angle Color Gradient
facen = FaceNormals(Mesh=del)  # -> Centers, Normals; disabled
Z = UnitZ(Factor=1)  # disabled
del_2 = DelaunayMesh(Points=facen.Centers, Plane=PlaneXY(0, 0, 0))  # disabled
demesh = DeconstructMesh(Mesh=del_2)  # -> Vertices, Faces, Colours, Normals; disabled
angle = Angle(VectorA=demesh.Normals, VectorB=Z)  # -> Angle, Reflex; disabled
bnd = Bounds(Numbers=angle.Angle)  # disabled
remap = RemapNumbers(Value=angle.Angle, Source=bnd, Target=Domain(0, 1))  # -> Mapped, Clipped; disabled
gradient = Gradient(
    LowerLimit=0,
    UpperLimit=1,
    Parameter=remap.Mapped,
    stops=[0: RGB(255, 255, 255), 0: RGB(255, 255, 255), 0.175: RGB(233, 170, 0), 0.268: RGB(209, 126, 0), 0.373: RGB(158, 43, 44)])  # disabled
conmesh = ConstructMesh(Vertices=facen.Centers, Faces=demesh.Faces, Colours=gradient)  # disabled

# ----
# Elevation Color Gradient
demesh_2 = DeconstructMesh(Mesh=del)  # -> Vertices, Faces, Colours, Normals; disabled
pdecon = Deconstruct(Point=demesh_2.Vertices)  # -> XComponent, YComponent, ZComponent; disabled
bnd_2 = Bounds(Numbers=pdecon.ZComponent)  # disabled
remap_2 = RemapNumbers(Value=pdecon.ZComponent, Source=bnd_2, Target=Domain(0, 1))  # -> Mapped, Clipped; disabled
gradient_2 = Gradient(
    LowerLimit=0,
    UpperLimit=1,
    Parameter=remap_2.Mapped,
    stops=[0: RGB(0, 0, 118), 0.126: RGB(0, 57, 118), 0.26: RGB(0, 116, 130), 0.871: RGB(255, 255, 255)])  # disabled
conmesh_2 = ConstructMesh(Vertices=demesh_2.Vertices, Faces=demesh_2.Faces, Colours=gradient_2)  # disabled

Z_2 = UnitZ(Factor=1)  # disabled
mesh_uv = MeshSurface(Surface=srf, UCount=5, VCount=5, Overhang=True, Equalize=False)  # disabled
facen_2 = FaceNormals(Mesh=mesh_uv)  # -> Centers, Normals; disabled

# ----
# This part is just
# to visualize the
# vectors that are
# being compared.
vdis = VectorDisplay(Anchor=facen.Centers, Vector=Z)  # disabled
vdis_2 = VectorDisplay(Anchor=facen.Centers, Vector=facen.Normals)  # disabled

demesh_3 = DeconstructMesh(Mesh=mesh_uv)  # -> Vertices, Faces, Colours, Normals; disabled
del_3 = DelaunayMesh(Points=facen_2.Centers, Plane=PlaneXY(0, 0, 0))  # disabled
vdis_3 = VectorDisplay(Anchor=facen_2.Centers, Vector=Z_2)  # disabled
vdis_4 = VectorDisplay(Anchor=facen_2.Centers, Vector=facen_2.Normals)  # disabled
demesh_4 = DeconstructMesh(Mesh=del_3)  # -> Vertices, Faces, Colours, Normals; disabled
angle_2 = Angle(VectorA=facen_2.Normals, VectorB=Z_2)  # -> Angle, Reflex; disabled
min = Minimum(A=demesh_3.Faces)  # disabled
sort = SortList(Keys=demesh_3.Faces)  # -> Keys, ValuesA; disabled
deface = DeconstructFace(Face=demesh_3.Faces)  # -> CornerA, CornerB, CornerC, CornerD; disabled
pdecon_2 = Deconstruct(Point=demesh_3.Vertices)  # -> XComponent, YComponent, ZComponent; disabled
bnd_3 = Bounds(Numbers=angle_2.Angle)  # disabled
ins = InsertItems(Wrap=True)  # disabled
remap_3 = RemapNumbers(Value=angle_2.Angle, Source=bnd_3, Target=Domain(0, 1))  # -> Mapped, Clipped; disabled
gradient_3 = Gradient(LowerLimit=0, UpperLimit=1, Parameter=remap_3.Mapped, stops=[0: RGB(0, 116, 130), 1: RGB(255, 255, 255)])  # disabled
conmesh_3 = ConstructMesh(Vertices=facen_2.Centers, Faces=demesh_4.Faces, Colours=gradient_3)  # disabled

# ----
# You may want to blur the gradient,
# though this is less precise.
number_slider_2 = Slider(0, range=0..10)  # disabled
mblur = BlurMesh(Mesh=conmesh, Iterations=number_slider_2)  # disabled
