# Grasshopper definition TopoSurfaces.gh (Grasshopper 0.9.70)

# ----
# TITLE:Subtitle
# Description:
# build topo surfaces from contours as mesh or NURBS
# 
# Author(s):
# GH Version:
# Last Modified by:
# Last Modified Date:
# Required Plugins:
# Additional Assets Required:
# 
# Notes/Issues:
# Set your topo lines into
# the Curve component
crv = Curve([<curve referenced from the Rhino model> x5000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])

# ----
# Check to see how many control
# points you've got.  Here's a quick guide:
# 
# 50k or fewer points for meshes
# 10k or fewer points for NURBS surfaces
cp = ControlPoints(Curve=crv)  # -> Points, Weights, Knots

# ----
# This will reduce the number of points.
# To control the number of points in the
# final list, adjust the pattern (P) in the
# "Cull" component.  Right click on the
# P input and go to "Set Multiple Booleans."
# Then "Bake" the output.
redpline = Reduce(Polyline=crv, Tolerance=1)  # -> Polyline, Reduction
cp_2 = ControlPoints(Curve=redpline.Polyline)  # -> Points, Weights, Knots
cull = CullPattern(List=cp_2.Points, CullPattern=[False, False, False, False, True])

# ----
# Set the points and Patch for a
# NURBS surface or use the Delaunay
# component for a triangulated mesh.
# You may have a smaller set for the
# surface and a larger set for the mesh.
# Set the number of
# spans to decide
# the precision of
# the surface.
pt = Point([<point referenced from the Rhino model> x4760])
pt_2 = Point([<point referenced from the Rhino model> x4760])
del = DelaunayMesh(Points=pt_2, Plane=PlaneXY(0, 0, 0))
patch = Patch(Points=pt, Spans=Slider(20, range=0..100), Flexibility=1, Trim=True)
